# Grasshopper definition sandbox.gh (Grasshopper 1.0.7)
# plug-ins: Pufferfish

# ----
# (1) Measure lip to set radius.
# (1) Adjust lip.
radius = Slider(42.025, range=40..45)
e2 = Vector(Vector(0, 0, 1))
origin = Point(Point(0, 0, 0))
circle = CircleCNR(Center=origin, Normal=e2, Radius=radius)

# ----
# 1. Create circle on lip
# 2. Create middle circle (adjust radius = pinch, adjust height = pinch height)
# 3. Create upper circle (adjust radius = open, adjust height = height)
# 
# Select angles on middle and top circles to define curves to loft (alternatively perturb in and out by a random amount) (adjust npoints = number of angles to use)
# 
# On upper circle modulate up and down in z (sin(xy))
# 
# Add twist to pinch
crv = Curve(<curve referenced from the Rhino model>)
cp = ControlPoints(Curve=crv)  # -> Points, Weights, Knots
h1_base_height = Slider(3, range=2..10)
h2_hook_height = Slider(7, range=5..10)
w1_inner_lip = Slider(5, range=5..25)
w2_outer_lip = Slider(5, range=5..25)
pt = Point(flatten(cp.Points))
python = GhPythonScript(r=radius, h1=h1_base_height, h2=h2_hook_height, w1=w1_inner_lip, w2=w2_outer_lip, pts=pt)  # -> out, a; inputs pts: list
# ---------- python: Python ----------
"""Provides a scripting component.
    Inputs:
        r:   The outer radius of the object 
        h1:  The height of the lip base 
        h2:  The height of the hook 
        w1:  The inner width of the lip (how far into r)
        w2:  The outer width of the lip (how far out from r)
        pts: The points of the original curve 
    Output:
        a: The a output variable"""

__author__ = "soniahashim"

import rhinoscriptsyntax as rs

p0 = pts[0]; p1 = pts[1]; p2 = pts[2]; 
p3 = pts[3]; p4 = pts[4]; 

X = 0; Y = 1; Z = 2


# Set curve radius 
x = -r 
p0[X] = x 
p4[X] = x

# Use the inner width of the lip 
p1[X] = x + w1
p2[X] = x + w1 

# Use the outer width of the lip 
p3[X] = x - w2

# Use the height of the lip base 
p2[Z] = h1 
p3[Z] = h1

# Use the height of the hook 
y = -h2 
p4[Z] = y


a = [p0,p1,p2,p3,p4]

print(a)
# ---------- end python ----------
_1 = Number(1)
nurbs = NurbsCurve(Vertices=python.a, Degree=_1, Periodic=False)  # -> Curve, Length, Domain
crv_2 = Curve(nurbs.Curve)

rp_pinch_radius = Slider(-34, range=-50..50)
ro_open_radius = Slider(-10, range=-50..50)
ho_open_height = Slider(17, range=0..25)
hp_pinch_height = Slider(4, range=0..25)
rb_loft_points = Slider(15, range=10..100)
t_loft_type = Slider(2, range=0..5)
line = Line(Line((0, 0, 0), (0, 0, 10)))
railrev = RailRevolution(Curve=crv_2, Rail=circle, Axis=line, Scale=False)
python_2 = GhPythonScript(r=radius, hb=h1_base_height, hp=hp_pinch_height, ho=ho_open_height, rp=rp_pinch_radius, ro=ro_open_radius)  # -> out, a; inputs hb: Int32, hp: Int32, ho: Int32
# ---------- python_2: Python ----------
"""Provides a scripting component.
    Inputs:
        r: The radius of the base 
        hb: The height of the base
        hp: The height offset of the pinch
        ho: The height offset of the opening
        rp: The radius offset of the pinch
        ro: The radius offset of the opening 
    Output:
        a: The a output variable"""

__author__ = "soniahashim"

import rhinoscriptsyntax as rs
import Rhino.Geometry as geom 

'''
method: translate
params: x,y,z; translation in x,y,z
-------------------------------------------------------------
Returns an affine translation matrix that translates by x,y,z
'''
def translate(x,y,z):
    t = geom.Transform.Identity
    t.M03 = x
    t.M13 = y
    t.M23 = z
    return t


base = geom.Circle(geom.Point3d.Origin, r).ToNurbsCurve()
t = translate(0,0,hb)
base.Transform(t)

pinch = geom.Circle(geom.Point3d.Origin, r+rp).ToNurbsCurve()
t = translate(0,0, hb+hp)
pinch.Transform(t)

open = geom.Circle(geom.Point3d.Origin, r+ro).ToNurbsCurve()
t = translate(0,0, hb+ho)
open.Transform(t)


a = [base,pinch,open]
# ---------- end python_2 ----------
loft_opt = LoftOptions(Closed=False, Adjust=False, Rebuild=rb_loft_points, Refit=0, Type=t_loft_type)
loft = Loft(Curves=python_2.a, Options=loft_opt)
offsrf = OffsetSurface(Surface=loft, Distance=1, BothSides=False, CreateSolid=True)
join = BrepJoin(Breps=[railrev, offsrf])  # -> graft(Breps), Closed
sunion = SolidUnion(Breps=flatten(join.Breps))  # disabled
panel = Panel(sunion)
